vi "Rx_main.gvi"   [LabVIEW NXG]
panel controls:
  "IQ rate": f64 = 500000
  "carrier frequency": f64 = 2450000000
  "gain": f64 = 10
  "PSK type": enum{"normal", "shifted", "offset"} = "normal"
  "samples per symbol": i32 = 16
  "M-PSK": i32 = 4
  "modulation type": T1 = "PSK"
  "pulse shaping filter": T2 = "Root Raised Cos"
  "filter parameter": f64 = 0.5
  "stopFetchingLoop": bool
  "packet_size_with_padding": f64 = 10624
  "wanted_sync_index": f64 = 60
  "correction": f64 = 0.02
  "multiple": f64 = 10000
  "soundSamplesPerPacket": i32 = 128
  "bitsPerSample": i32 = 8
  "uLaw": bool
  "CheckMatrixLocation": path
  "LDPC": bool
  "itMax": i32
panel indicators:
  "Sync_Found?": bool
  "Sync_Index": f64
  "Demodulated IQ Graph": T3[]
  "SoundOutput": waveform<f64>[]
  "loop iteration": i32
  "Decoded": i32[]
types:
  T1 = enum{"FSK", "PSK", "QAM", "MSK", "PAM", "ASK", "CPM"}
  T2 = enum{"none", "Raised Cosine", "Root Raised Cos", "Gaussian"}
  T3 = cluster{"constellation": f64[], "oversampled data": f64[]}
  T4 = cluster{"sample rate": f64, "number of channels": i32, "bits per sample": i32}
  T5 = cluster{"samples per symbol (16)": i32, "symbol map": c128[], "differential PSK": enum{"disable", "enable"}, "PSK type": enum{"normal", "shifted", "offset"}}
  T6 = cluster{"expected sync location (symbols)": i32, "sync sequence": c128[], "sync location uncertainty (symbols)": i32, "sync indent (symbols)": i32}
  T7 = cluster{"psk_system_params": T5, "pulse_shaping_filter_coeffs": f64[], "matched_filter_coeffs": f64[], "sync_params": T6, "sync_seq_bits": i8[]}
diagram:
  w1 = $LDPC
  w2 = T4 {"sample rate"=6000, "number of channels"=1, "bits per sample"=8}
  w3 = $wanted_sync_index
  w4 = $packet_size_with_padding
  w5 = $soundSamplesPerPacket
  w6 = $bitsPerSample
  w7 = $correction
  w8 = $multiple
  case (w1) {
    frame False, Default {
      w9 = $"samples per symbol"
    }
    frame True {
      Divide(x=$"samples per symbol", y=2) -> w10
      Round Toward Negative Infinity(x=w10) -> w9
    }
  }
  call "initPSK.gvi"(PSK type=$"PSK type", samples per symbol=w9, M-PSK=$"M-PSK", modulation type=$"modulation type", pulse shaping filter=$"pulse shaping filter", filter parameter=$"filter parameter", PSK_params_in=T7 {all zero or empty}) -> (PSK_params_out=w11)
  call "Sound Output Configure.gvi"(device ID=0, sound format=w2, number of samples per channel=8000) -> (task ID=w12, error out=w13)
  call "Sound Output Start.gvi"(task ID=w12, error in=w13) -> (task ID out=w14, error out=w15)
  call "Read from Spreadsheet File (DBL).gvi"(file path=$CheckMatrixLocation, format="%.3f", delimiter=",") -> (all rows=w16)
  call "niUSRP Open Rx Session.gvi"(Device names="192.168.10.2") -> (Error Out=w17, Session handle=w18)
  call "niUSRP Configure Signal.gvi"(session handle=w18, IQ rate=$"IQ rate", carrier frequency=$"carrier frequency", gain=$gain, error in (no error)=w17, active antenna="RX1") -> (session handle out=w19, Error Out=w20)
  call "niUSRP Initiate.gvi"(session handle=w19, error in (no error)=w20) -> (session handle out=w21, Error Out=w22)
  w23 = cluster{"t0": f64, "dt": f64, "Y": c128[]} {all zero or empty}
  s1 = w23  # shift register
  s2 = uninitialised  # shift register
  s3 = uninitialised  # shift register
  while (iteration -> i1) {
    call "demodulation_block.gvi"(data=s1, PSK_params_in=w11) -> (output bit stream=w24, recovered complex waveform=w25, Sync_Found?=w26, sync found index=w27)
    Is Greater Than 0(x=i1) -> w28
    case (w28) {
      frame False, Default {
        w29 = w4
        w30 = w21
        w31 = w22
      }
      frame True {
        Not(x=w28) -> w32
        call "adjust_Samples_to_sync.gvi"(wanted_sync_index=w3, current_sync_index=w27, packet_size_with_padding=w4, first_interation?=w32, sync_location_last_iteration=s2, samples_last_interation=s3) -> (new_NumOfSamples=w29)
        w30 = w21
        w31 = w22
      }
    }
    To Unsigned Quad Integer(number=w29) -> w33
    call "niUSRP Fetch Rx Data (CDB Cluster).gvi"(session handle=w30, number of samples=w33, error in (no error)=w31) -> (session handle out=w34, data=w35, Error Out=w36)
    Multiply(w5, w6) -> w37
    case (w1) {
      frame False, Default {
        call "extractDataBits.gvi"(appendedArray=w24, dataBitsPerPacket=w37) -> (dataArray=w38)
        w39 = default
      }
      frame True {
        Multiply(2, w37) -> w40
        call "extractDataBits.gvi"(appendedArray=w24, dataBitsPerPacket=w40) -> (dataArray=w41)
        call "ldpcDecoding.gvi"(ReceivedMessage=w41, CheckMatrix=w16, itMax=$itMax) -> (MesageDecoded=w38)
        Array Size(array=w41) -> (size(s)=w42)
        Is Equal(x=w42, y=w40) -> w39
      }
    }
    Feedback Node(Input=w43) -> (Output=w44)
    case (w39) {
      frame False, Default {
        w43 = w44
      }
      frame True {
        Build Array[ConcatenateInputs=True](i1, w44) -> w43
      }
    }
    $Decoded <- w43
    $"loop iteration" <- i1
    call "soundBitStream2Integer.gvi"(bitStream=w38, numberOfSoundSamples=w5, bitsPerSample=w6) -> (integerArray=w45)
    case ($uLaw) {
      frame False, Default {
        To Double Precision Float(number=w45) -> w46
      }
      frame True {
        call "uLawDecodeArray8to16bits.gvi"(X=w45) -> (Y=w46)
      }
    }
    call "deShiftAndMultSoundArray.gvi"(unprocessedSoundArray=w46, correction=w7, multiple=w8) -> (processedArray=w47)
    Property Node(instance in=w2) -> ("sample rate"=w48)
    Reciprocal(x=w48) -> w49
    Build Waveform Node(Y=w47, dt=w49, t0=1904-01-01T00:00:00Z) -> (output waveform=w50)
    Build Array(w50, waveform<f64> {dt=1, Y=[]}) -> w51
    call "Sound Output Write.gvi"(task ID=w14, data=w51, error in=w15) -> (task ID out=w52, error out=w53)
    $"Sync_Found?" <- w26
    $Sync_Index <- w27
    $SoundOutput <- w51
    call "MT Format Constellation.gvi"(waveform=w25) -> (constellation graph=w54)
    $"Demodulated IQ Graph" <- w54
    next s1 = w35
    next s2 = w27
    next s3 = w29
    stop if $stopFetchingLoop
  }
  call "niUSRP Abort.gvi"(Handle in=w34, error in (no error)=w36) -> (Handle out=w55, Error Out=w56)
  call "niUSRP Close Session.gvi"(Handle in=w55, error in (no error)=w56)
  call "Sound Output Stop.gvi"(task ID=w52, error in=w53) -> (task ID out=w57, error out=w58)
  call "Sound Output Clear.gvi"(task ID=w57, error in=w58)
